# Dynamo graph EFFACER LES VUES COMMERCIAL_script.dyn (Dynamo 1.3.3.4111)

# group: Effacer famille commercial
element_types = ElementTypes("ViewPlan")
all_elements_of_type = ElementsOfType(element_types)
code_block = CodeBlock { "Nom de la vue"; }
getParameterValueByName = Element.GetParameterValueByName(element=all_elements_of_type, parameterName=code_block)
code_block_2 = CodeBlock { "Æ02"; }
contains = String.Contains(str=getParameterValueByName, searchFor=code_block_2)
filterByBoolMask = List.FilterByBoolMask(list=all_elements_of_type, mask=contains)
watch = Watch(filterByBoolMask.out)
watch_2 = Watch(filterByBoolMask.in)
delete = archilab.Revit.Elements.Elements.Delete(watch_2)

# group: Effacer famille commercial - vue de détail
element_types_2 = ElementTypes("ViewDrafting")
all_elements_of_type_2 = ElementsOfType(element_types_2)
code_block_3 = CodeBlock { "Nom de la vue"; }
getParameterValueByName_2 = Element.GetParameterValueByName(element=all_elements_of_type_2, parameterName=code_block_3)
code_block_4 = CodeBlock { "Æ02"; }
contains_2 = String.Contains(str=getParameterValueByName_2, searchFor=code_block_4)
filterByBoolMask_2 = List.FilterByBoolMask(list=all_elements_of_type_2, mask=contains_2)
watch_3 = Watch(filterByBoolMask_2.out)
watch_4 = Watch(filterByBoolMask_2.in)
delete_2 = archilab.Revit.Elements.Elements.Delete(watch_4)
