# Dynamo graph 01_EFFACER LES VUES CORPO_script.dyn (Dynamo 1.3.3.4111)

# group: Effacer famille corpo
element_types = ElementTypes("ViewPlan")
all_elements_of_type = ElementsOfType(element_types)
code_block = CodeBlock { "Nom de la vue"; }
getParameterValueByName = Element.GetParameterValueByName(element=all_elements_of_type, parameterName=code_block)
code_block_2 = CodeBlock { "Æ03"; }
contains = String.Contains(str=getParameterValueByName, searchFor=code_block_2)
filterByBoolMask = List.FilterByBoolMask(list=all_elements_of_type, mask=contains)
watch = Watch(filterByBoolMask.out)
watch_2 = Watch(filterByBoolMask.in)
delete = archilab.Revit.Elements.Elements.Delete(watch_2)
