# Dynamo graph 02_SOUS_PROJETS_script.dyn "01_SOUS_PROJETS" (Dynamo 2.3.1.11775)
# packages: ParametricMonkey 1.3.5

code_block = CodeBlock()
# ---------- code_block.designscript (20 lines) ----------
["A_INFRASTRUCTURE",
"B10_STRUCTURE",
"B20_ENVELOPPE",
"C_AMENAGEMENT INTÉRIEUR",
"D_SERVICES",
"E_EQUIPEMENT ET AMEUBLEMENT",
"F_CONSTRUCTION SPECIALE ET DEMOLITION",
"G_AMENAGEMENT D'EMPLACEMENT",
"ZG_AXES ET NIVEAUX SECONDAIRES",
"ZG_PLANS DE RÉFÉRENCE",
"ZL_1-ARCHITECTURE",
"ZL_2-STRUCTURE",
"ZL_3-MÉCANIQUE",
"ZL_4-ELECTRIQUE",
"ZL_5-P-INCENDIE",
"ZL_6-CIVIL",
"ZL_7-AMENAGEMENT INTÉRIEUR",
"ZL_8-AMENAGEMENT EXTÉRIEUR",
"ZL_X-CAD",
"ZL_X-NUAGE DE POINTS"];
# ----------------------------------------

# group: Package BVN (nécessaire)
code_block_2 = CodeBlock { "ZG_AXES ET NIVEAUX"; }
code_block_3 = CodeBlock { "B10_SUPERSTRUCTURE"; }

createAndRenameDefault = Custom[Workset.CreateAndRenameDefault](newWorksetNames=code_block, sharedLevelsAndGridName=code_block_2, workset1Name=code_block_3)  # package ParametricMonkey; Creates new worksets from a list as well as renaming the default worksets (Shared levels and grids, and Workset 1). Tutorial: https://parametricmonkey.com/2017/05/04/create-worksets/
watch = Watch()  # unwired: arg0
